# Grasshopper definition Coordinates.gh (Grasshopper 1.0.7)
# Copyright: Arup
# plug-ins: TT Toolbox

crv = Curve(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)
crv_2 = Curve(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)
crv_3 = Curve(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)
crv_4 = Curve(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)
pt = Point([Point(0, -107, -1), Point(0, -192.4568771, -1), Point(0, -234, -1), Point(0, -234, 31.27063692), Point(0, -234, 82), Point(0, -168, 20), Point(0, -107, 82)])
crv_5 = Curve(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)
explode = Explode(Curve=crv_4, Recursive=True)  # -> Segments, Vertices
cullduppoints = RemoveDuplicatePoints(InputPoints=explode.Vertices, Tolerance=0.001)  # -> OutputPoints, FirstPointIndexes
clean = CleanTree(RemoveNulls=True, RemoveInvalid=True, RemoveEmpty=False, Tree=cullduppoints.OutputPoints)
panel = Panel(pt)
pt_2 = Point(clean)
panel_2 = Panel(pt_2)
